# Requirement set Cruisecntrlsys (R2023b)

## 1 [#1] The system shall control the vehicle's speed

### 1.1 [#12] The system shall maintain the speed within 10% error compared to reference speed.

## 2 [#4] When the system is set on, the speed manager shall set the current speed as a reference.

## 3 [#5] when the system is set off, the speed manager shall delete all the speed data.

## 4 [#6] The speed manager shall set the system on.

## 5 [#7] The speed manager shall set the system off

## 6 [#8] The speed manager shall pause the system.

## 7 [#9] The speed manager shall run the system.

## 8 [#10] When the system switches on pause state, the system shall record the reference speed.

## 9 [#11] When the system switches to "run" state, the system shall set the recorded speed as reference.