% Requirement links of LogicalArch.slx (R2023b)

block :1 implements FnctnArch.slx#13: FnctnArch/Control (Component)
block :2 implements FnctnArch.slx#10: FnctnArch/Actuate (Component)
block :3 implements FnctnArch.slx#1: FnctnArch/Measure (Component)
block :4 implements FnctnArch.slx#19: FnctnArch/defining state (Component)