# Requirement set Autonomous_Cleaning_System (R2022b)

## 1 [REQ - 0] The user shall program the time in which the system turns on.

### 1.1 [REQ - 0.2] The cleaning robot shall emit the turning on signal.

### 1.2 [REQ - 0.1] The timer shall be set. (Informational)

## 2 [REQ - 1] The cleaning robot shall clean autonomously the house floors.

### 2.1 [REQ - 1.1] The cleaning robot shall remove the dust. (Informational)

## 3 [REQ - 2] The cleaning system shall use the sensors to navigate within the environment.

### 3.1 [REQ - 2.1] The cleaning robot shall detect obstacles.

### 3.2 [REQ - 2.2] If an obstacle is detected, the cleaning robot shall avoid the obstacle.

#### 3.2.1 [REQ - 2.2.1] The cleaning robot shall change the direction when the obstacle is within 20cm. (Informational)

## 4 [REQ - 3] The cleaning robot shall detect the different types of floors.

### 4.1 [REQ - 3.1] The cleaning robot shall adjust the the action according to the type of floor.

#### 4.1.1 [REQ - 3.1.1] If a marble floor is detected, the cleaning system shall enable gentle surface function. (Informational)

#### 4.1.2 [REQ - 3.1.2] If a wood floor is detected, the cleaning system shall enable wood surface function. (Informational)

#### 4.1.3 [REQ - 3.1.3] If a carpet is detected, the cleaning system shall enable carpet surface function. (Informational)

## 5 [REQ - 4] When the cleaning robot has finished to clean the house, the cleaning robot shall return to the docking station.

### 5.1 [REQ - 4.1] The docking station shall charge the cleaning robot.

### 5.2 [REQ - 4.2] The docking station shall turn off the cleaning robot.

### 5.3 [REQ - 4.3] The cleaning robot shall emit the turning off signal.